# Dynamo graph dynamo techoo.dyn (Dynamo 2.1.0.7500)

categories = Categories("OST_Mass")
all_elements_of_category = ElementsOfCategory(Category=categories)
curves = Element.Curves(element=all_elements_of_category)
geometry = Element.Geometry(element=all_elements_of_category)
explode = Geometry.Explode(geometry=geometry)
number = DoubleInput(0)
getItemAtIndex = List.GetItemAtIndex(list=explode@L4, index=number)
