# Dynamo graph Homeeee.dyn (Dynamo 2.2.1.5175)

categories = Categories("OST_Mass")
all_elements_of_category = ElementsOfCategory(Category=categories)
curves = Element.Curves(element=all_elements_of_category)
number_slider = DoubleSlider(1, range=0..100 step 0.1)
getItemAtIndex = List.GetItemAtIndex()  # unwired: list, index
geometry = Element.Geometry(element=all_elements_of_category)
explode = Geometry.Explode(geometry=geometry@L4)
number = DoubleInput(4)
getItemAtIndex_2 = List.GetItemAtIndex(list=explode, index=number)
code_block = CodeBlock { a = 0..7..#9; }
watch = Watch(code_block)
code_block_2 = CodeBlock { a = 0..10..#9; }
watch_2 = Watch(code_block_2)
pointAtParameter = Surface.PointAtParameter(surface=getItemAtIndex_2, u=watch, v=watch_2, lacing=CrossProduct)
thicken = Surface.Thicken()  # unwired: surface
