# Dynamo graph Ariel_1.dyn (Dynamo 2.5.0.7460)

edges = Topology.Edges()  # unwired: topology
categories = Categories("OST_Mass")
all_elements_of_category = ElementsOfCategory(Category=categories)
geometry = Element.Geometry(element=all_elements_of_category)
explode = Geometry.Explode(geometry=geometry)
number_slider = DoubleSlider(2, range=0..20 step 1)
getItemAtIndex = List.GetItemAtIndex(list=explode, index=number_slider)
number_slider_2 = DoubleSlider(3, range=0..3 step 1)
getItemAtIndex_2 = List.GetItemAtIndex(list=getItemAtIndex@L2, index=number_slider_2)
perimeterCurves = Surface.PerimeterCurves(surface=getItemAtIndex_2)
byLoft = Surface.ByLoft(crossSections=perimeterCurves)
pointAtParameter = Surface.PointAtParameter(surface=byLoft)
code_block = CodeBlock()
# ---------- code_block.designscript (18 lines) ----------
x_pos = 1;
y_pos = 2;
z_pos = 3;

pCoord = Point.ByCoordinates(x_pos, y_pos, z_pos);

cs = CoordinateSystem.Identity();
pCoordSystem = Point.ByCartesianCoordinates(cs, x_pos, y_pos, z_pos);

radius = 5;
height = 15;
theta = 75.5;

pCyl = Point.ByCylindricalCoordinates(cs, radius, theta, height);

phi = 120.3;

pSphere = Point.BySphericalCoordinates(cs, radius, theta, phi);
# ----------------------------------------
number_slider_3 = DoubleSlider(0, range=0..1 step 1)
number_slider_4 = DoubleSlider(0.5, range=0..1 step 0.1)
getIsoline = Surface.GetIsoline(surface=byLoft, isoDirection=number_slider_3, parameter=number_slider_4)
byLoft_2 = Surface.ByLoft(guideCurves=getIsoline)  # unwired: crossSections
number_slider_5 = DoubleSlider(1, range=0..1 step 0.1)
number_slider_6 = DoubleSlider(1, range=0..1 step 0.1)
pointAtParameter_2 = Surface.PointAtParameter(u=number_slider_5, v=number_slider_6)  # unwired: surface
number_slider_7 = DoubleSlider(0, range=0..1 step 1)
number_slider_8 = DoubleSlider(0.5, range=0..1 step 0.1)
getIsoline_2 = Surface.GetIsoline(surface=byLoft, isoDirection=number_slider_7, parameter=number_slider_8)
endPoint = Curve.EndPoint(curve=getIsoline)
number_slider_9 = DoubleSlider(0.6, range=0..1 step 0.1)
pointAtParameter_3 = Curve.PointAtParameter(curve=getIsoline, param=number_slider_9)
ZAxis = Vector.ZAxis()
number_slider_10 = DoubleSlider(-1, range=-100..100 step 1)
scale = Vector.Scale(vector=ZAxis, scale_factor=number_slider_10)
translate = Geometry.Translate(geometry=pointAtParameter_3, direction=scale)
number_slider_11 = DoubleSlider(0.4, range=0..1 step 0.1)
pointAtParameter_4 = Curve.PointAtParameter(curve=getIsoline, param=number_slider_11)
ZAxis_2 = Vector.ZAxis()
number_slider_12 = DoubleSlider(-2, range=-100..100 step 1)
scale_2 = Vector.Scale(vector=ZAxis_2, scale_factor=number_slider_12)
translate_2 = Geometry.Translate(geometry=pointAtParameter_4, direction=scale_2)
startPoint = Curve.StartPoint(curve=getIsoline)
list_create = List.Create(item0=endPoint, item1=translate, item2=translate_2, item3=startPoint)
flatten = List.Flatten(list=list_create)
byBestFitThroughPoints = Arc.ByBestFitThroughPoints(points=flatten)
list_create_2 = List.Create(item0=perimeterCurves, item1=byBestFitThroughPoints)
flatten_2 = List.Flatten(list=list_create_2)
number_slider_13 = DoubleSlider(2, range=0..2 step 1)
getItemAtIndex_3 = List.GetItemAtIndex(list=flatten_2@L2, index=number_slider_13)
byControlPoints = NurbsCurve.ByControlPoints(points=flatten)
list_create_3 = List.Create(item0=perimeterCurves)
number_slider_14 = DoubleSlider(0, range=0..1 step 1)
getItemAtIndex_4 = List.GetItemAtIndex(list=list_create_3@L2, index=number_slider_14)
list_create_4 = List.Create(item0=byControlPoints, item1=getItemAtIndex_4)
flatten_3 = List.Flatten(list=list_create_4)
byLoft_3 = Surface.ByLoft(crossSections=flatten_3)
number_slider_15 = DoubleSlider(0.1, range=0..1 step 0.1)
thicken = Surface.Thicken(surface=byLoft_3, thickness=number_slider_15)
wall_types = WallTypes("Generic - 150mm")
number_slider_16 = DoubleSlider(1, range=0..1 step 1)
getItemAtIndex_5 = List.GetItemAtIndex(list=list_create_3@L2, index=number_slider_16)
list_create_5 = List.Create(item0=byControlPoints, item1=getItemAtIndex_5)
flatten_4 = List.Flatten(list=list_create_5)
byLoft_4 = Surface.ByLoft(crossSections=flatten_4)
thicken_2 = Surface.Thicken(surface=byLoft_4, thickness=number_slider_15)
byFace = Wall.ByFace(wallType=wall_types, surface=thicken_2)  # unwired: locationLine
