# Dynamo graph Ismail_1.dyn (Dynamo 2.5.0.7460)

categories = Categories("OST_Mass")
all_elements_of_category = ElementsOfCategory(Category=categories)
geometry = Element.Geometry(element=all_elements_of_category)
explode = Geometry.Explode(geometry=geometry)
number_slider = DoubleSlider(0, range=0..2 step 1)
getItemAtIndex = List.GetItemAtIndex(list=explode, index=number_slider)
number_slider_2 = DoubleSlider(0, range=0..4 step 1)
getItemAtIndex_2 = List.GetItemAtIndex(list=getItemAtIndex@L2, index=number_slider_2)
faces = Topology.Faces(topology=getItemAtIndex_2)
vertices = Topology.Vertices(topology=getItemAtIndex_2)
number_slider_3 = DoubleSlider(0, range=0..2 step 1)
getItemAtIndex_3 = List.GetItemAtIndex(list=vertices@L2, index=number_slider_3)
pointGeometry = Vertex.PointGeometry(vertex=getItemAtIndex_3)

# group: move
ZAxis = Vector.ZAxis()
translate = Geometry.Translate(geometry=pointGeometry, direction=ZAxis)
XAxis = Vector.XAxis()
YAxis = Vector.YAxis()

edges = Topology.Edges(topology=getItemAtIndex_2)
number_slider_4 = DoubleSlider(0, range=0..3 step 1)
getItemAtIndex_4 = List.GetItemAtIndex(list=edges, index=number_slider_4)
number_slider_5 = DoubleSlider(1, range=0..3 step 1)
getItemAtIndex_5 = List.GetItemAtIndex(list=getItemAtIndex_4, index=number_slider_5)
number_slider_6 = DoubleSlider(1, range=0..100 step 0.1)
mul = ZAxis * number_slider_6
byPatch = Surface.ByPatch()  # unwired: closedCurve
