# Dynamo graph ejercicio1.dyn (Dynamo 2.5.0.7460)

categories = Categories("OST_Mass")
all_elements_of_category = ElementsOfCategory(Category=categories)
geometry = Element.Geometry(element=all_elements_of_category)
explode = Geometry.Explode(geometry=geometry)
number = DoubleInput(2)
getItemAtIndex = List.GetItemAtIndex(list=explode, index=number)
explode_2 = Geometry.Explode(geometry=getItemAtIndex@@L2)
number_2 = DoubleInput(3)
getItemAtIndex_2 = List.GetItemAtIndex(list=explode_2@L3, index=number_2)
perimeterCurves = Surface.PerimeterCurves(surface=getItemAtIndex_2)
number_slider = DoubleSlider(0.5, range=0..1 step 0.1)
pointAtParameter = Curve.PointAtParameter(curve=perimeterCurves, param=number_slider)
splitByPoints = Curve.SplitByPoints(curve=perimeterCurves, points=pointAtParameter)
code_block = CodeBlock { a = 0..1..#25; }
watch = Watch(code_block)
code_block_2 = CodeBlock { a = 0..1..#25; }
watch_2 = Watch(code_block_2)
pointAtParameter_2 = Surface.PointAtParameter(surface=getItemAtIndex_2, u=watch, v=watch_2, lacing=CrossProduct)
watch_3 = Watch(pointAtParameter_2)
byLoft = Surface.ByLoft()  # unwired: crossSections, guideCurves
number_slider_2 = DoubleSlider(0.2, range=0..1 step 0.1)
number_slider_3 = DoubleSlider(0.7, range=0..1 step 0.1)
coordinateSystemAtParameter = Surface.CoordinateSystemAtParameter(surface=getItemAtIndex_2, u=number_slider_2, v=number_slider_3)
thicken = Surface.Thicken(surface=getItemAtIndex_2)
watch_4 = Watch(thicken)
number_3 = DoubleInput(0)
translate = Geometry.Translate()  # unwired: geometry
number_4 = DoubleInput(5)
getItemAtIndex_3 = List.GetItemAtIndex(list=pointAtParameter_2@L4, index=number_4)
number_slider_4 = DoubleSlider(2, range=0..8 step 1)
getItemAtIndex_4 = List.GetItemAtIndex(list=getItemAtIndex_3@L3, index=number_slider_4)
number_slider_5 = DoubleSlider(0, range=0..100 step 1)
number_slider_6 = DoubleSlider(0, range=0..10 step 1)
number_slider_7 = DoubleSlider(15, range=0..100 step 1)
byCoordinates = Vector.ByCoordinates(x=number_slider_5, y=number_slider_6, z=number_slider_7)
translate_2 = Geometry.Translate(geometry=getItemAtIndex_4, direction=byCoordinates)
byPoints = NurbsSurface.ByPoints()  # unwired: points
